# Dynamo graph tower-mass.dyn (Dynamo 2.18.1.5096)

setValue = Parameter.SetValue()  # unwired: parameter, value
string = StringInput("height")
parameterByName = Parameter.ParameterByName(name=string)  # unwired: element
parameters = Element.Parameters()  # unwired: element
watch = Watch()  # unwired: arg0
